# Dynamo graph Reordring Elements.dyn "KT-BIM-DYN-Reordring Elements" (Dynamo 2.18.1.5096)

# note: Important
# This script need shared parameter
# Oreder: common, text
# Part: common, text
# Type: common, text
select_model_elements = DSModelElementsSelection()  # 18 picked in the model

# group: Create List of Certain Family
code_block = CodeBlock { "Family and Type"; }
getParameterValueByName = Element.GetParameterValueByName(element=select_model_elements, parameterName=code_block)
string_from_object = FromObject(object=getParameterValueByName)
family_types = FamilyTypes("Fire Alarm Detectors:SMOKE W SOUND BASE")
string_from_object_2 = FromObject(object=family_types)
eq = string_from_object == string_from_object_2
filterByBoolMask = List.FilterByBoolMask(list=select_model_elements, mask=eq)

# group: Give Element's Key
id = Element.Id(element=filterByBoolMask.in)
sortByKey = List.SortByKey(list=filterByBoolMask.in, keys=id)

# group: Reorder
string = StringInput("Order")
code_block_2 = CodeBlock { 1..10000..1; }
string_from_object_3 = FromObject(object=code_block_2)
setParameterByName = Element.SetParameterByName(element=sortByKey.sortedList, parameterName=string, value=string_from_object_3)

parameters = Element.Parameters(element=select_model_elements)
parameters_2 = Element.Parameters(element=sortByKey.sortedList)
parameters_3 = Element.Parameters(element=filterByBoolMask.in)

# group: Part or Zone
string_2 = StringInput("Part")
code_block_3 = CodeBlock { "Pt."; }
custom_selection = CustomSelection("One", items={One: "1", Two: "2", Three: "3"})
code_block_4 = CodeBlock(x=code_block_3, y=custom_selection) { x+y; }
string_from_object_4 = FromObject(object=code_block_4)
setParameterByName_2 = Element.SetParameterByName(element=sortByKey.sortedList, parameterName=string_2, value=string_from_object_4)

# group: Type of Connection
string_3 = StringInput("Connection")
code_block_5 = CodeBlock { "Emerg"; }
setParameterByName_3 = Element.SetParameterByName(element=sortByKey.sortedList, parameterName=string_3, value=code_block_5)

# group: Type of Family
string_4 = StringInput("Element Type")
code_block_6 = CodeBlock { "Sm"; }
setParameterByName_4 = Element.SetParameterByName(element=sortByKey.sortedList, parameterName=string_4, value=code_block_6)
